vi "Keynote Dashboard.gvi"   [Next Generation LabVIEW Features 0.1.0]
panel controls:
  "stop": bool
  "Power Button": bool
  "Slider": f64
panel indicators:
  "Low": f64
  "High": f64
  "Graph": waveform<f64>
  "Responses": f64
  "Intensity Graph": f64[][]
  "Error": error
types:
  "Sound Data Format.gtype" = cluster{"sample rate (S/s)": f64, "number of channels": i32, "bits per sample": i32}
uses:
  NI::Analysis::Measurement::STFT Spectrogram.gvi
diagram:
  w1 = "Sound Data Format.gtype" {"sample rate (S/s)"=22000, "number of channels"=2, "bits per sample"=16}
  call "Sound Output Configure.gvi"(sound format=w1, number of samples/ch=2048) -> (task ID=w2, error out=w3)
  s1 = w3  # shift register
  s2 = w2  # shift register
  while {
    call "Read Tags.gvi"() -> (High=w4, Low=w5, Pitch Ratio=w6, Responses=w7)
    $Responses <- w7
    call "Read Audio Port.gvi"(Number of Samples=2048) -> (data=w8)
    case ($"Power Button") {
      frame False, Default {
        Build Array(w8) -> w10
        w9 = w8
      }
      frame True {
        call "Pitch Change.gvi"(Waveform in=w8, PitchRatio=$Slider) -> (Array of Waveform=w10, Waveform out=w9)
      }
    }
    call "Write Waveform Tag.gvi"(Waveform=w9)
    $High <- w4
    $Low <- w5
    $Graph <- w9
    call "STFT Spectrogram.gvi"(x=w9) -> (STFT spectrogram=w11)
    $"Intensity Graph" <- w11
    call "Sound Output Write.gvi"(task ID in=s2, data=w10) -> (task ID out=w12, error out=w13)
    Logical Or(w13, $stop) -> w14
    next s1 = w13
    next s2 = w12
    stop if w14
  }
  $Error <- s1
