vi "Modulate Audio.gvi"   [Next Generation LabVIEW Features 0.1.0]
inputs:
  "Enable Pitch Shift Button": bool
  "Modulation Scheme": bool
  "Audio Sample": waveform<f64> = {dt=0.1, Y=[]}
  "Error": error
outputs:
  "x": f64[]
  "data": waveform<f64>[]
  "error in": error
diagram:
  call "Slice waveform.gvi"(Waveform=$"Audio Sample", Error=$Error) -> (Waveform_2=w1, Error_2=w2)
  call "Vocoder OLD.gvi"(Modulation Scheme=$"Modulation Scheme", Enable Pitch Shift Button=$"Enable Pitch Shift Button", Waveform_2=w1, Error=w2) -> (x=w3, data=w4, error in=w5)
  $x <- w3
  $data <- w4
  $"error in" <- w5
