vi "Function.gvi"   [LabVIEW Platform Developer Preview 0.1.0]
panel controls:
  "Low": bool
  "High": bool
panel indicators:
  "Low Hit": bool
  "High Hit": bool
  "Gauge": f64
uses:
  Component::Read Double Tag.gvi
  Component::Update Tag.gvi
diagram:
  while {
    Wait(time to wait=1000)
    call "Read Double Tag.gvi"(Server="skyline.southcentralus.cloudapp.azure.com", Tag="modulation") -> (Average=w1)
    $Gauge <- w1
    stop if FALSE
  }
  while {
    Wait(time to wait=50)
    case ($Low) {
      frame False, Default {
        $"Low Hit" <- FALSE
      }
      frame True {
        Wait(time to wait=100)
        $"Low Hit" <- TRUE
        call "Update Tag.gvi"(Server="skyline.southcentralus.cloudapp.azure.com", Tag="modulation", Tag Value=0)
      }
    }
    case ($High) {
      frame False, Default {
        $"High Hit" <- FALSE
      }
      frame True {
        Wait(time to wait=100)
        $"High Hit" <- TRUE
        call "Update Tag.gvi"(Server="skyline.southcentralus.cloudapp.azure.com", Tag="modulation", Tag Value=2)
      }
    }
    stop if FALSE
  }
